# Grasshopper definition shelf-final.gh (Grasshopper 1.0.7)

lang = Slider(300, range=0..500)
shelfheight = Slider(300, range=0..500)
number_slider = Slider(0.1, range=0..0.1)
xz_plane = XZPlane(Origin=Point(0, 0, 0))
length = GetNumber(lang, AtLeast=1, AtMost=1, Maximum=1.797693135e+308, Minimum=-1.797693135e+308)
height = GetNumber(shelfheight, AtLeast=1, AtMost=1, Maximum=1.797693135e+308, Minimum=-1.797693135e+308)
# thickness
number_slider_2 = Slider(2, range=0..10)
material_thickness = GetNumber(number_slider_2, AtLeast=1, AtMost=1, Maximum=1.797693135e+308, Minimum=-1.797693135e+308)

unit_x = UnitX(Factor=material_thickness)
unit_z = UnitZ(Factor=material_thickness)
negative = Negative(Value=unit_x)
negative_2 = Negative(Value=unit_z)

division = Division(A=unit_z, B=number_slider_2)
unit_z_2 = UnitZ(Factor=division)

division_2 = Division(A=material_thickness, B=Slider(2, range=0..10))

multiplication = Multiplication(A=height, B=number_slider)
multiplication_2 = Multiplication(A=length, B=number_slider)
plane_surface = PlaneSurface(Plane=xz_plane, XSize=length, YSize=height)
divide_surface = DivideSurface(Surface=plane_surface, UCount=multiplication_2, VCount=multiplication)  # -> Points, Normals, Parameters
# shelf style - for sine
number_slider_3 = Slider(58.2, range=0..100)
deconstruct = Deconstruct(Point=divide_surface.Points)  # -> XComponent, YComponent, ZComponent
adjust_style = GetNumber(number_slider_3, AtLeast=1, AtMost=1, Maximum=1.797693135e+308, Minimum=-1.797693135e+308)
division_3 = Division(A=deconstruct.XComponent, B=adjust_style)
division_4 = Division(A=deconstruct.ZComponent, B=adjust_style)
material_thickness_2 = Slider(40, range=0..100)
sine = Sine(Value=division_3)
cosine = Cosine(Value=division_4)
multiplication_3 = Multiplication(A=sine, B=cosine)
multiplication_4 = Multiplication(A=multiplication_3, B=Slider(25, range=10..25))

depth = GetNumber(material_thickness_2, AtLeast=1, AtMost=1, Maximum=1.797693135e+308, Minimum=-1.797693135e+308)

addition = Addition(A=multiplication_4, B=depth)
negative_3 = Negative(Value=addition)
construct_point = ConstructPoint(XCoordinate=deconstruct.XComponent, YCoordinate=negative_3, ZCoordinate=deconstruct.ZComponent)
construct_point_2 = ConstructPoint(XCoordinate=deconstruct.XComponent, YCoordinate=negative_3, ZCoordinate=deconstruct.ZComponent)
surface_from_points = SurfaceFromPoints(Points=flatten(construct_point), UCount=expr("x+1", multiplication_2), Interpolate=False)
project = Project(Geometry=surface_from_points, Plane=xz_plane)  # -> Geometry, Transform
curve = Curve(surface_from_points)
weave = Weave(Pattern=[0, 1], Stream0=curve, Stream1=project.Geometry, NullGaps=False)
loft = Loft(Curves=weave, Options={Adjust=False, Closed=False, LoftEnds=0, LoftSimp=0, LoftType=0, Rebuild=10, Refit=0.01})
merge = Merge(Data1=plane_surface, Data2=loft, Data3=surface_from_points)

# ----
# subdivision
deconstruct_brep = DeconstructBrep(Brep=plane_surface)  # -> Faces, Edges, Vertices
deconstruct_brep_2 = DeconstructBrep(Brep=plane_surface)  # -> Faces, Edges, Vertices
number_slider_4 = Slider(10, range=0..100)
number_slider_5 = Slider(10, range=0..100)
brep_join = BrepJoin(Breps=merge)  # -> Breps, Closed
list_item = ListItem(List=deconstruct_brep.Edges, Index=0, Wrap=True)
list_item_2 = ListItem(List=deconstruct_brep_2.Edges, Index=1, Wrap=True)
subdivision_vertical = GetNumber(number_slider_5, AtLeast=1, AtMost=1, Maximum=1.797693135e+308, Minimum=-1.797693135e+308)
subdivision_horizontal = GetNumber(number_slider_4, AtLeast=1, AtMost=1, Maximum=1.797693135e+308, Minimum=-1.797693135e+308)
perp_frames = PerpFrames(Curve=list_item, Count=subdivision_vertical, Align=True)  # -> Frames, Parameters
perp_frames_2 = PerpFrames(Curve=list_item_2, Count=subdivision_horizontal, Align=True)  # -> Frames, Parameters
brep_plane = BrepPlane(Brep=brep_join.Breps, Plane=perp_frames_2.Frames)  # -> flatten(Curves), Points
brep_plane_2 = BrepPlane(Brep=brep_join.Breps, Plane=perp_frames.Frames)  # -> flatten(Curves), Points

# ----
# cull outter ribs
# if required
number_slider_6 = Slider(0, range=0..100)
cull_index = CullIndex(List=reverse(brep_plane.Curves), Indices=number_slider_6, Wrap=True)
cull_index_2 = CullIndex(List=reverse(cull_index), Indices=number_slider_6, Wrap=True)
list_item_3 = ListItem(List=reverse(brep_plane.Curves), Index=0, Wrap=True)
list_item_4 = ListItem(List=brep_plane.Curves, Index=0, Wrap=True)

number_slider_7 = Slider(0, range=0..100)
cull_index_3 = CullIndex(List=brep_plane_2.Curves, Indices=number_slider_7, Wrap=True)
list_item_5 = ListItem(List=reverse(flatten(brep_plane_2.Curves)), Index=0, Wrap=True)
list_item_6 = ListItem(List=brep_plane_2.Curves, Index=0, Wrap=True)
cull_index_4 = CullIndex(List=reverse(cull_index_3), Indices=number_slider_7, Wrap=True)

move = Move(Geometry=list_item_3, Motion=expr("-x", unit_z_2))  # -> Geometry, Transform
move_2 = Move(Geometry=cull_index_2, Motion=unit_z)  # -> Geometry, Transform
move_3 = Move(Geometry=list_item_4, Motion=unit_z_2)  # -> Geometry, Transform

series = Series(Start=0, Step=1, Count=expr("x+1", number_slider_5))  # -> flatten(Series)
series_2 = Series(Start=0, Step=1, Count=expr("x+1", number_slider_4))  # -> flatten(Series)

division_5 = Division(A=unit_x, B=number_slider_2)
move_4 = Move(Geometry=cull_index_4, Motion=unit_x)  # -> Geometry, Transform
move_5 = Move(Geometry=list_item_6, Motion=expr("-x", division_5))  # -> Geometry, Transform

unit_x_2 = UnitX(Factor=division_5)

move_6 = Move(Geometry=list_item_5, Motion=unit_x_2)  # -> Geometry, Transform

surface = Surface([move_4.Geometry, move_6.Geometry, move_5.Geometry])
surface_2 = Surface([move_2.Geometry, move_3.Geometry, move.Geometry])

compute_blueprint = GetBoolean(Toggle(True), AtLeast=1, AtMost=1, FalseValue="False", TrueValue="True")
stream_gate = StreamGate(Stream=surface, Gate=compute_blueprint)  # -> Target0, Target1, Target2, Target3

stream_gate_2 = StreamGate(Stream=surface_2, Gate=compute_blueprint)  # -> Target0, Target1, Target2, Target3

# ----
# intersection
cross_reference = CrossReference(ListListA=stream_gate.Target1, ListListB=stream_gate_2.Target1, CrossMode=1)  # -> ListListA, ListListB
brep_brep = BrepBrep(BrepA=cross_reference.ListListA, BrepB=cross_reference.ListListB)  # -> Curves, Points
division_6 = Division(A=material_thickness, B=Slider(2, range=0..10))
number_slider_8 = Slider(0.5, range=0..1)
construct_domain = ConstructDomain(DomainStart=number_slider_8, DomainEnd=1)
sub_curve = SubCurve(BaseCurve=reparameterize(brep_brep.Curves), Domain=number_slider_8)
sub_curve_2 = SubCurve(BaseCurve=reparameterize(brep_brep.Curves), Domain=construct_domain)
extend_curve = ExtendCurve(Curve=sub_curve_2, Type=0, Start="0", End=sub_curve_2)
extend_curve_2 = ExtendCurve(Curve=sub_curve, Type=0, Start=sub_curve, End="0")
pipe = Pipe(Curve=extend_curve, Radius=division_6, Caps=1)  # -> flatten(Pipe)
pipe_2 = Pipe(Curve=extend_curve_2, Radius=division_6, Caps=1)  # -> flatten(Pipe)
trim_solid = TrimSolid(Shape=stream_gate_2.Target1, Cutters=pipe)
trim_solid_2 = TrimSolid(Shape=stream_gate.Target1, Cutters=pipe_2)
unit_x_3 = UnitX(Factor=division_2)
unit_z_3 = UnitZ(Factor=division_2)
negative_4 = Negative(Value=unit_x_3)
negative_5 = Negative(Value=unit_z_3)
extrude = Extrude(Base=trim_solid_2, Direction=[unit_x_3, negative_4])
extrude_2 = Extrude(Base=trim_solid, Direction=[negative_5, unit_z_3])

list_length = ListLength(List=surface_2)

# ----
# cost estimation
area = Area(Geometry=[surface, surface_2])  # -> Area, Centroid
curve_2 = Curve(surface_2)
curve_3 = Curve(surface)
length_2 = Length(Curve=[curve_3, curve_2])
mass_addition = MassAddition(Input=length_2)  # -> Result, PartialResults
mass_addition_2 = MassAddition(Input=area.Area)  # -> Result, PartialResults
division_7 = Division(A=mass_addition.Result, B="2400")
multiplication_5 = Multiplication(A=division_7, B="100")
multiplication_6 = Multiplication(A=mass_addition_2.Result, B="0.0001")
multiplication_7 = Multiplication(A=multiplication_6, B="36")
addition_2 = Addition(A=multiplication_5, B=multiplication_7)
multiplication_8 = Multiplication(A=addition_2, B="2")
format = Format(Format="{0:0.00}", Culture=127, Data0=multiplication_8)
c_script = CSharpScript(crv=[curve_3, curve_2], cost=format)  # -> out, A; inputs crv: Curve, cost: String
# ---------- c_script: C# ----------
    crv.SetUserString("cost", cost);
    A = crv;
# ---------- end c_script ----------

extrude_3 = Extrude(Base=stream_gate.Target0, Direction=negative)
extrude_4 = Extrude(Base=stream_gate_2.Target0, Direction=negative_2)

# ----
# vertical
solid_union = SolidUnion(Breps=extrude)

# ----
# horizontal
solid_union_2 = SolidUnion(Breps=extrude_2)

is_planar = IsPlanar(Surface=trim_solid, Interior=True)  # -> Planar, Plane
orient = Orient(Geometry=flatten(solid_union_2), Source=flatten(is_planar.Plane), Target=PlaneXY(0, 0, 0))  # -> Geometry, Transform

is_planar_2 = IsPlanar(Surface=trim_solid_2, Interior=True)  # -> Planar, Plane
orient_2 = Orient(Geometry=flatten(solid_union), Source=flatten(is_planar_2.Plane), Target=PlaneXY(0, 0, 0))  # -> Geometry, Transform

# ---- group: RH_OUT:view
mesh = Mesh([extrude_4, extrude_3])

# ----
rotate = Rotate(Geometry=orient_2.Geometry, Angle=1.570796327, Plane=PlaneXY(0, 0, 0))  # -> Geometry, Transform
format_2 = Format(Format="{0:0.00}", Culture=127, Data0=multiplication_6)

# ----
# unroll
box = Box(rotate.Geometry)
deconstruct_brep_3 = DeconstructBrep(Brep=box)  # -> Faces, Edges, Vertices
list_item_7 = ListItem(List=deconstruct_brep_3.Edges, Index=1, Wrap=True)
number = Number(list_item_7)
multiplication_9 = Multiplication(A=number, B=Slider(1.6, range=0..10))
mass_addition_3 = MassAddition(Input=flatten(multiplication_9))  # -> Result, PartialResults
unit_y = UnitY(Factor=mass_addition_3.PartialResults)
move_7 = Move(Geometry=rotate.Geometry, Motion=unit_y)  # -> Geometry, Transform

list_item_8 = ListItem(List=flatten(format), Index=1, Wrap=True)
mass_addition_4 = MassAddition(Input=flatten(format_2))  # -> Result, PartialResults
mass_addition_5 = MassAddition(Input=flatten(format))  # -> Result, PartialResults

# ---- group: RH_OUT:preferences
curve_4 = Curve(flatten(c_script.A))

# ---- group: RH_OUT:area
data = Data(mass_addition_4.Result)

# ---- group: RH_OUT:cost
data_2 = Data(mass_addition_5.Result)

# ----
panel = Panel(data)
panel_2 = Panel(data_2)
box_2 = Box(move_7.Geometry)
evaluate_box = EvaluateBox(Box=box_2, UParameter=0.5, VParameter=0.5, WParameter=0.5)  # -> flatten(Plane), Point, Include
text_tag_3d = TextTag3D(Location=evaluate_box.Plane, Series=series_2, Size=Slider(10, range=0..10), Justification=7)

# ----
# unroll
box_3 = Box(orient.Geometry)
deconstruct_brep_4 = DeconstructBrep(Brep=box_3)  # -> Faces, Edges, Vertices
list_item_9 = ListItem(List=deconstruct_brep_4.Edges, Index=1, Wrap=True)
number_2 = Number(list_item_9)
multiplication_10 = Multiplication(A=number_2, B=Slider(1.8, range=0..10))
mass_addition_6 = MassAddition(Input=flatten(multiplication_10))  # -> Result, PartialResults

list_item_10 = ListItem(List=deconstruct_brep_4.Edges, Index=0, Wrap=True)

number_3 = Number(list_item_10)
multiplication_11 = Multiplication(A=number_3, B=Slider(1.4, range=0..10))

vector_xyz = VectorXYZ(XComponent=flatten(multiplication_11), YComponent=mass_addition_6.PartialResults, ZComponent=0)  # -> flatten(Vector), Length

move_8 = Move(Geometry=flatten(orient.Geometry), Motion=vector_xyz.Vector)  # -> flatten(Geometry), Transform

box_4 = Box(move_8.Geometry)
evaluate_box_2 = EvaluateBox(Box=box_4, UParameter=0.5, VParameter=0.5, WParameter=0.5)  # -> flatten(Plane), Point, Include
text_tag_3d_2 = TextTag3D(Location=evaluate_box_2.Plane, Series=series, Size=Slider(10, range=0..10), Justification=7)

# ---- group: RH_OUT:mesh
mesh_2 = Mesh([solid_union, solid_union_2, move_8.Geometry, move_7.Geometry])

# ----
custom_preview = CustomPreview(
    Geometry=mesh_2,
    Material={diffuse=RGB(221, 160, 221), emission=RGB(66, 48, 66), shine=0.5, specular=RGB(255, 255, 255), transparency=0})
