# Grasshopper definition shelf.gh (Grasshopper 1.0.7)

lang = Slider(500, range=0..1000)
shelfheight = Slider(300, range=0..500)
number_slider = Slider(0.1, range=0..0.1)
xz_plane = XZPlane(Origin=Point(0, 0, 0))
radius = GetNumber(lang, AtLeast=1, AtMost=1, Maximum=1.797693135e+308, Minimum=-1.797693135e+308)
count = GetNumber(shelfheight, AtLeast=1, AtMost=1, Maximum=1.797693135e+308, Minimum=-1.797693135e+308)

multiplication = Multiplication(A=count, B=number_slider)
multiplication_2 = Multiplication(A=radius, B=number_slider)
plane_surface = PlaneSurface(Plane=xz_plane, XSize=radius, YSize=count)
divide_surface = DivideSurface(Surface=plane_surface, UCount=multiplication_2, VCount=multiplication)  # -> Points, Normals, Parameters
deconstruct = Deconstruct(Point=divide_surface.Points)  # -> XComponent, YComponent, ZComponent
# shelf style - for sine
style = GetNumber(Slider(0.4, range=-0.6..0.4), AtLeast=1, AtMost=1, Maximum=1.797693135e+308, Minimum=-1.797693135e+308)
division = Division(A=deconstruct.XComponent, B=style)
division_2 = Division(A=deconstruct.ZComponent, B=style)
material_thickness = Slider(40, range=0..100)
sine = Sine(Value=division)
cosine = Cosine(Value=division_2)
multiplication_3 = Multiplication(A=sine, B=cosine)
multiplication_4 = Multiplication(A=multiplication_3, B=Slider(25, range=10..25))
# shelf type
# - jagged,
# - sin
# - simple
# - boxes
addition = Addition(A=multiplication_4, B=material_thickness)
negative = Negative(Value=addition)
construct_point = ConstructPoint(XCoordinate=deconstruct.XComponent, YCoordinate=negative, ZCoordinate=deconstruct.ZComponent)
construct_point_2 = ConstructPoint(XCoordinate=deconstruct.XComponent, YCoordinate=negative, ZCoordinate=deconstruct.ZComponent)
surface_from_points = SurfaceFromPoints(Points=flatten(construct_point), UCount=expr("x+1", multiplication_2), Interpolate=False)
project = Project(Geometry=surface_from_points, Plane=xz_plane)  # -> Geometry, Transform
curve = Curve(surface_from_points)
weave = Weave(Pattern=[0, 1], Stream0=curve, Stream1=project.Geometry, NullGaps=False)
loft = Loft(Curves=weave, Options={Adjust=False, Closed=False, LoftEnds=0, LoftSimp=0, LoftType=0, Rebuild=10, Refit=0.01})
merge = Merge(Data1=plane_surface, Data2=loft, Data3=surface_from_points)

number_slider_2 = Slider(25, range=0..100)
brep_join = BrepJoin(Breps=merge)  # -> Breps, Closed
unit_x = UnitX(Factor=1)
# subdivision
unit_z = UnitZ(Factor=1)
contour = Contour(Shape=brep_join.Breps, Point=Point(0, 0, 0), Direction=unit_x, Distance=number_slider_2)  # -> flatten(Contours)
contour_2 = Contour(Shape=brep_join.Breps, Point=Point(0, 0, 0), Direction=unit_z, Distance=number_slider_2)  # -> flatten(Contours)

number_slider_3 = Slider(0, range=0..100)
cull_index = CullIndex(List=contour_2, Indices=number_slider_3, Wrap=True)
# cull outter ribs
# if required
cull_index_2 = CullIndex(List=cull_index, Indices=number_slider_3, Wrap=True)

# ----
# thickness
number_slider_4 = Slider(2, range=0..10)

number_slider_5 = Slider(0, range=0..100)
cull_index_3 = CullIndex(List=contour, Indices=number_slider_5, Wrap=True)  # -> reverse(List)
cull_index_4 = CullIndex(List=cull_index_3, Indices=number_slider_5, Wrap=True)

unit_x_2 = UnitX(Factor=number_slider_4)
move = Move(Geometry=cull_index_4, Motion=unit_x_2)  # -> Geometry, Transform
unit_z_2 = UnitZ(Factor=number_slider_4)
move_2 = Move(Geometry=contour_2, Motion=unit_z_2)  # -> Geometry, Transform
negative_2 = Negative(Value=unit_z_2)
negative_3 = Negative(Value=unit_x_2)
surface = Surface(move_2.Geometry)
surface_2 = Surface(move.Geometry)

get_boolean = GetBoolean(Toggle(True), AtLeast=1, AtMost=1, FalseValue="False", TrueValue="True")
stream_gate = StreamGate(Stream=surface_2, Gate=get_boolean)  # -> Target0, Target1, Target2, Target3

stream_gate_2 = StreamGate(Stream=surface, Gate=get_boolean)  # -> Target0, Target1, Target2, Target3

# ----
# cost estimation
area = Area(Geometry=[stream_gate.Target1, stream_gate_2.Target1])  # -> Area, Centroid
curve_2 = Curve(surface)
curve_3 = Curve(surface_2)
length = Length(Curve=curve_3)
mass_addition = MassAddition(Input=length)  # -> Result, PartialResults
mass_addition_2 = MassAddition(Input=area.Area)  # -> Result, PartialResults
division_3 = Division(A=mass_addition.Result, B="2400")
multiplication_5 = Multiplication(A=division_3, B="100")
multiplication_6 = Multiplication(A=mass_addition_2.Result, B="0.0001")
multiplication_7 = Multiplication(A=multiplication_6, B="36")
addition_2 = Addition(A=multiplication_5, B=multiplication_7)
multiplication_8 = Multiplication(A=addition_2, B="2")
format = Format(Format="{0:0.00}", Culture=127, Data0=multiplication_8)
c_script = CSharpScript(crv=[curve_3, curve_2], cost=format)  # -> out, A; inputs crv: Curve, cost: String
# ---------- c_script: C# ----------
    crv.SetUserString("cost", cost);
    A = crv;
# ---------- end c_script ----------

extrude = Extrude(Base=stream_gate.Target0, Direction=negative_3)
extrude_2 = Extrude(Base=stream_gate_2.Target0, Direction=negative_2)

# ---- group: RH_OUT:view
geometry = Geometry([extrude_2, extrude])

# ---- group: RH_OUT:preferences
curve_4 = Curve(flatten(c_script.A))

# ----
division_4 = Division(A=number_slider_4, B=Slider(2, range=0..10))

cross_reference = CrossReference(ListListA=stream_gate.Target1, ListListB=stream_gate_2.Target1, CrossMode=1)  # -> ListListA, ListListB
brep_brep = BrepBrep(BrepA=cross_reference.ListListA, BrepB=cross_reference.ListListB)  # -> Curves, Points
division_5 = Division(A=number_slider_4, B=Slider(2, range=0..10))
number_slider_6 = Slider(0.5, range=0..1)
construct_domain = ConstructDomain(DomainStart=number_slider_6, DomainEnd=1)
sub_curve = SubCurve(BaseCurve=reparameterize(brep_brep.Curves), Domain=construct_domain)
sub_curve_2 = SubCurve(BaseCurve=reparameterize(brep_brep.Curves), Domain=number_slider_6)
extend_curve = ExtendCurve(Curve=sub_curve, Type=0, Start="0", End=sub_curve)
extend_curve_2 = ExtendCurve(Curve=sub_curve_2, Type=0, Start=sub_curve_2, End="0")
pipe = Pipe(Curve=extend_curve, Radius=division_5, Caps=1)  # -> flatten(Pipe)
pipe_2 = Pipe(Curve=extend_curve_2, Radius=division_5, Caps=1)  # -> flatten(Pipe)
trim_solid = TrimSolid(Shape=stream_gate_2.Target1, Cutters=pipe)
trim_solid_2 = TrimSolid(Shape=stream_gate.Target1, Cutters=pipe_2)
unit_x_3 = UnitX(Factor=division_4)
unit_z_3 = UnitZ(Factor=division_4)
negative_4 = Negative(Value=unit_x_3)
negative_5 = Negative(Value=unit_z_3)
extrude_3 = Extrude(Base=trim_solid_2, Direction=[unit_x_3, negative_4])
extrude_4 = Extrude(Base=trim_solid, Direction=[negative_5, unit_z_3])
solid_union = SolidUnion(Breps=extrude_3)
solid_union_2 = SolidUnion(Breps=extrude_4)

# ---- group: RH_OUT:mesh
mesh = Mesh([solid_union, solid_union_2])

# ----
custom_preview = CustomPreview(
    Geometry=mesh,
    Material={diffuse=RGB(221, 160, 221), emission=RGB(66, 48, 66), shine=0.5, specular=RGB(255, 255, 255), transparency=0})
